# Grasshopper definition divideicon.gh (Grasshopper 0.9.14)
# plug-ins: Squid

rec = Rectangle({Plane=PlaneXY(0, 0, 0), Size=Domain2(u=0..240, v=0..240)})
rec_2 = Rectangle({Plane=PlaneXY(0, 0, 0), Size=Domain2(u=0..240, v=0..240)})
vec = VectorXYZ(XComponent=Slider(-10, range=-240..240), YComponent=Slider(0, range=-240..240), ZComponent=Slider(0, range=-240..240))  # -> Vector, Length
vec_2 = VectorXYZ(XComponent=Slider(10, range=-240..240), YComponent=Slider(-10, range=-240..240), ZComponent=Slider(0, range=-240..240))  # -> Vector, Length
swatch = ColourSwatch(SwatchColor=RGB(255, 255, 255))
move = Move(Geometry=rec, Motion=vec.Vector)  # -> Geometry, Transform
move_2 = Move(Geometry=rec_2, Motion=vec_2.Vector)  # -> Geometry, Transform
area = Area(Geometry=move.Geometry)  # -> Area, Centroid
area_2 = Area(Geometry=move_2.Geometry)  # -> Area, Centroid
slider = Slider(16, range=0..20)
slider_2 = Slider(10, range=0..20)
cir = Circle(Plane=area.Centroid, Radius=Slider(90, range=0..1000))
polygon = Polygon(Plane=area.Centroid, Radius=Slider(80, range=0..1000), Segments=Slider(5, range=0..100), FilletRadius=0)  # -> Polygon, Length
cir_2 = Circle(Plane=area_2.Centroid, Radius=Slider(90, range=0..1000))
polygon_2 = Polygon(Plane=area_2.Centroid, Radius=Slider(80, range=0..1000), Segments=Slider(5, range=0..100), FilletRadius=0)  # -> Polygon, Length
outline = Outline(Color=ColourSwatch(SwatchColor=RGB(0, 0, 0)), Width=slider)
outline_2 = Outline(Color=ColourSwatch(SwatchColor=RGB(0, 0, 0)), Width=slider_2)
outline_3 = Outline(Color=swatch, Width=slider)
outline_4 = Outline(Color=swatch, Width=slider_2)
draw = Draw(Curve=polygon.Polygon, Accuracy=-1, Outline=outline)  # -> SquidInstr, Curve
draw_2 = Draw(Curve=cir, Accuracy=-1, Outline=outline_2)  # -> SquidInstr, Curve
draw_3 = Draw(Curve=polygon_2.Polygon, Accuracy=-1, Outline=outline_3)  # -> SquidInstr, Curve
draw_4 = Draw(Curve=cir_2, Accuracy=-1, Outline=outline_4)  # -> SquidInstr, Curve
outline_5 = Outline(Color=RGB(0, 0, 0), Width=Slider(10, range=0..10))
disc = Discontinuity(Curve=polygon.Polygon, Level=1)  # -> Points, Parameters
disc_2 = Discontinuity(Curve=polygon_2.Polygon, Level=1)  # -> Points, Parameters
outline_6 = Outline(Color=swatch, Width=Slider(10, range=0..10))
cir_3 = Circle(Plane=disc.Points, Radius=Slider(18, range=0..100))
cir_4 = Circle(Plane=disc_2.Points, Radius=Slider(18, range=0..100))
rec_3 = Rectangle({Plane=PlaneXY(0, 0, 0), Size=Domain2(u=0..24, v=0..24)})
rec_4 = Rectangle({Plane=PlaneXY(0, 0, 0), Size=Domain2(u=0..24, v=0..24)})
draw_5 = Draw(Curve=cir_3, Accuracy=-1, Outline=outline_5, Fill=ColourSwatch(SwatchColor=RGB(255, 255, 255)))  # -> SquidInstr, Curve
merge = Merge(Data1=flatten(draw_2.SquidInstr), Data2=flatten(draw.SquidInstr), Data3=flatten(draw_5.SquidInstr))
squid = Squid(BitmapR=rec, SquidInstr=merge, PPU=1, AA=True, autohide=False)
draw_6 = Draw(Curve=cir_4, Accuracy=-1, Outline=outline_6, Fill=swatch)  # -> SquidInstr, Curve
merge_2 = Merge(Data1=flatten(draw_4.SquidInstr), Data2=flatten(draw_3.SquidInstr), Data3=flatten(draw_6.SquidInstr))
squid_2 = Squid(BitmapR=rec_2, SquidInstr=merge_2, PPU=1, AA=True, autohide=False)
image = Image(Bitmap=squid, Bounds=rec_3, Interpolate=Slider(3, range=0..10))
image_2 = Image(Bitmap=squid_2, Bounds=rec_4, Interpolate=Slider(3, range=0..10))
squid_3 = Squid(BitmapR=rec_4, SquidInstr=image_2, PPU=1, AA=True, autohide=False)
clear = Clear(Color=ColourSwatch(SwatchColor=RGBA(0, 0, 0, 128)))
alpha = Alpha(Bitmap=squid_3, Bounds=rec_4, Interpolate=0)
squid_4 = Squid(BitmapR=rec_3, SquidInstr=image, PPU=1, AA=True, autohide=False)
squid_5 = Squid(BitmapR=rec_4, SquidInstr=[clear, alpha], PPU=1, AA=True, autohide=False)
image_3 = Image(Bitmap=squid_4, Bounds=rec_3, Interpolate=0)
image_4 = Image(Bitmap=squid_5, Bounds=rec_3, Interpolate=0)
squid_6 = Squid(BitmapR=rec_3, SquidInstr=reverse([image_3, image_4]), PPU=1, AA=True, autohide=False)
