# Grasshopper definition qprev.gh (Grasshopper 0.9.14)
# plug-ins: Squid

rec = Rectangle({Plane=PlaneXY(0, 1, 0), Size=Domain2(u=0..23, v=0..23)})
rec_2 = Rectangle({Plane=PlaneXY(0, 0, 0), Size=Domain2(u=0..24, v=0..24)})
pcen = PolygonCenter(Polyline=rec)  # -> CenterV, CenterE
scale = Scale(Geometry=rec, Center=pcen.CenterV, Factor=Slider(1, range=0..1))  # -> Geometry, Transform
fillet = Fillet(Curve=scale.Geometry, Radius=Slider(1.588, range=0..10))
disc = Discontinuity(Curve=fillet, Level=Slider(2, range=0..10))  # -> Points, Parameters
pline = PolyLine(Vertices=disc.Points, Closed=True)
range = Range(Domain=Domain(0, 1), Steps=10)
offset = Offset(Curve=pline, Distance=Slider(-0.717, range=-2..2), Plane=PlaneXY(0, 0, 0), Corners=1)
gradient = Gradient(
    LowerLimit=0,
    UpperLimit=1,
    Parameter=range,
    stops=[0.359: RGB(39, 112, 25), 0.447: RGB(173, 203, 249), 1: RGB(75, 107, 169)])
draw = Draw(Curve=pline, Accuracy=Slider(1, range=0..1), Outline=ColourSwatch(SwatchColor=RGB(0, 0, 0)))  # -> SquidInstr, Curve
clear = Clear(Color=ColourSwatch(SwatchColor=RGB(224, 224, 224)))
draw_2 = Draw(Curve=offset, Accuracy=-1, Outline=ColourSwatch(SwatchColor=RGB(255, 255, 255)))  # -> SquidInstr, Curve
filll = FillLinear(Line=Line((11, 1, 0), (11, 24, 0)), Params=range, Colors=gradient)  # -> Fill, Points
rec_3 = Rectangle({Plane=PlaneXY(1, 2, 0), Size=Domain2(u=0..21, v=0..21)})
draw_3 = Draw(Curve=rec_3, Accuracy=-1, Fill=filll.Fill)  # -> SquidInstr, Curve
squid = Squid(BitmapR=rec_3, SquidInstr=draw_3.SquidInstr, PPU=1, AA=True, autohide=False)
image = Image(Bitmap=squid, Bounds=rec_3, Interpolate=0)
merge = Merge(Data1=flatten(clear), Data2=flatten(draw.SquidInstr), Data4=flatten(draw_2.SquidInstr), Data5=flatten(image))
squid_2 = Squid(BitmapR=rec_2, SquidInstr=merge, PPU=1, AA=True, autohide=False)
