# Grasshopper definition squidicon.gh (Grasshopper 0.9.14)
# plug-ins: Squid

geo = Geometry(<curve referenced from the Rhino model>)
pframes = PerpFrames(Curve=geo, Count=Slider(50, range=0..100), Align=True)  # -> Frames, Parameters
lng = ListLength(List=pframes.Frames)  # -> expr("l-1", Length)
range = Range(Domain=Domain(0, 1), Steps=lng)
geo_2 = Geometry(<curve referenced from the Rhino model>)
graph = GraphMapper(
    range,
    x0=0,
    x1=1,
    y0=0,
    y1=1,
    container_name="Bezier",
    cpx=[0, 0.3958120942, 0.627918601, 1],
    cpy=[0.7308590412, 0.7612525821, 0.5302146077, 0.2838608027])
pframes_2 = PerpFrames(Curve=geo_2, Count=Slider(50, range=0..100), Align=True)  # -> Frames, Parameters
multiplication = Multiplication(A=graph, B=Slider(20, range=0..50))
lng_2 = ListLength(List=pframes_2.Frames)  # -> expr("l-1", Length)
range_2 = Range(Domain=Domain(0, 1), Steps=lng_2)
cir = Circle(Plane=pframes.Frames, Radius=multiplication)
slider = Slider(77, range=0..100)
graph_2 = GraphMapper(
    range_2,
    x0=0,
    x1=1,
    y0=0,
    y1=1,
    container_name="Bezier",
    cpx=[0, 0.3958120942, 0.627918601, 1],
    cpy=[0.7308590412, 0.7612525821, 0.5302146077, 0.2838608027])
loft = Loft(Curves=cir, Options={Adjust=False, Closed=False, Rebuild=10, Refit=0.01, LoftType=0, LoftEnds=0, LoftSimp=0})
xy = XYPlane(Origin=Point(0, 0, 0))
cap = CapHoles(Brep=loft)
ext = Extend(Curve=geo, Type=1, Start=slider, End=slider)
multiplication_2 = Multiplication(A=graph_2, B=Slider(20, range=0..50))
sec = BrepPlane(Brep=cap, Plane=xy)  # -> Curves, Points
geo_3 = Geometry(<curve referenced from the Rhino model>)
cir_2 = Circle(Plane=pframes_2.Frames, Radius=multiplication_2)
offset = Offset(Curve=ext, Distance=Slider(1, range=-20..20), Plane=PlaneXY(0, 0, 0), Corners=1)
loft_2 = Loft(Curves=cir_2, Options={Adjust=False, Closed=False, Rebuild=10, Refit=0.01, LoftType=0, LoftEnds=0, LoftSimp=0})
runion = RegionUnion(Curves=flatten([sec.Curves, geo_3]))
end = EndPoints(Curve=geo)  # -> Start, End
xy_2 = XYPlane(Origin=Point(0, 0, 0))
cap_2 = CapHoles(Brep=loft_2)
srfsplit = SurfaceSplit(Surface=runion, Curves=offset)
outline = Outline(Color=RGB(0, 0, 0), Width=Slider(20, range=0..20))
explode = Explode(Curve=runion, Recursive=True)  # -> Segments, Vertices
sec_2 = BrepPlane(Brep=cap_2, Plane=xy_2)  # -> Curves, Points
geo_4 = Geometry(<curve referenced from the Rhino model>)
crv_cp = CurveCP(Point=end.Start, Curve=explode.Segments)  # -> Point, Parameter, Distance
item = ListItem(List=srfsplit, Index=0, Wrap=False)
rec = Rectangle({Plane=PlaneXY(0, 0, 0), Size=Domain2(u=0..240, v=0..240)})
runion_2 = RegionUnion(Curves=flatten([sec_2.Curves, geo_4]))
cull = CullPattern(List=explode.Segments, CullPattern=crv_cp.Distance)
draw = Draw(Curve=item, Accuracy=Slider(10, range=0..10), Fill=ColourSwatch(SwatchColor=RGB(92, 92, 92)))  # -> SquidInstr, Curve
draw_2 = Draw(Curve=cull, Accuracy=Slider(16, range=0..20), Outline=outline)  # -> SquidInstr, Curve
rec_2 = Rectangle({Plane=PlaneXY(0, 0, 0), Size=Domain2(u=0..240, v=0..240)})
draw_3 = Draw(Curve=runion_2, Accuracy=Slider(5, range=0..10), Fill=ColourSwatch(SwatchColor=RGBA(0, 0, 0, 128)))  # -> SquidInstr, Curve
draw_4 = Draw(Curve=runion, Accuracy=Slider(5, range=0..10), Fill=ColourSwatch(SwatchColor=RGB(212, 212, 212)))  # -> SquidInstr, Curve
rec_3 = Rectangle({Plane=PlaneXY(0, 0, 0), Size=Domain2(u=0..24, v=0..24)})
pt = PointXYZ(XComponent=Slider(0, range=-2..2), YComponent=Slider(0, range=-2..2), ZComponent=0, System=PlaneXY(0, 0, 0))
merge = Merge(Data1=flatten(draw_2.SquidInstr), Data2=flatten(draw_4.SquidInstr), Data3=flatten(draw.SquidInstr))  # -> flatten(Result)
squid = Squid(BitmapR=rec_2, SquidInstr=draw_3.SquidInstr, PPU=1, AA=True, autohide=False)
move = Move(Geometry=rec_3, Motion=pt)  # -> Geometry, Transform
rec_4 = Rectangle(move.Geometry)
clear = Clear(Color=ColourSwatch(SwatchColor=RGB(227, 227, 227)))
image = Image(Bitmap=squid, Bounds=rec_4, Interpolate=Slider(3, range=0..10))
vec = VectorXYZ(XComponent=Slider(2, range=0..10), YComponent=Slider(-2, range=-2..2), ZComponent=Slider(0, range=-2..2))  # -> Vector, Length
squid_2 = Squid(BitmapR=rec, SquidInstr=merge, PPU=1, AA=True, autohide=False)
squid_3 = Squid(BitmapR=rec_4, SquidInstr=image, PPU=1, AA=True, autohide=False)
rec_5 = Rectangle({Plane=PlaneXY(0, 0, 0), Size=Domain2(u=0..24, v=0..24)})
move_2 = Move(Geometry=rec_4, Motion=vec.Vector)  # -> Geometry, Transform
clear_2 = Clear(Color=ColourSwatch(SwatchColor=RGB(227, 227, 227)))  # disabled
image_2 = Image(Bitmap=squid_2, Bounds=rec_5, Interpolate=Slider(3, range=0..10))
squid_4 = Squid(BitmapR=rec_5, SquidInstr=[clear_2, image_2], PPU=1, AA=True, autohide=False)
image_3 = Image(Bitmap=squid_4, Bounds=rec_4, Interpolate=0)
rec_6 = Rectangle({Plane=PlaneXY(0, 0, 0), Size=Domain2(u=0..24, v=0..24)})
image_4 = Image(Bitmap=squid_3, Bounds=move_2.Geometry, Interpolate=0)
squid_5 = Squid(BitmapR=rec_6, SquidInstr=[image_4, image_3], PPU=1, AA=True, autohide=False)
