# Grasshopper definition texticon.gh (Grasshopper 0.9.14)
# plug-ins: Squid

font = Font(Family="Arial", Size=Slider(140, range=0..1000), Bold=True, Italic=False, Underline=False)
pt = PointXYZ(XComponent=Slider(60, range=0..240), YComponent=Slider(55, range=0..240), ZComponent=0, System=PlaneXY(0, 0, 0))
textc = TextCurves(Plane=pt, Text="T", Font=font)
offset = Offset(Curve=textc, Distance=Slider(-20, range=-100..100), Plane=PlaneXY(0, 0, 0), Corners=1)
pt_2 = PointXYZ(XComponent=Slider(20, range=-50..50), YComponent=Slider(-20, range=-50..50), ZComponent=0, System=PlaneXY(0, 0, 0))
slider = Slider(15, range=0..100)
simplify = SimplifyCurve(Curve=offset)  # -> Curve, Simplified
disc = Discontinuity(Curve=simplify.Curve, Level=1)  # -> Points, Parameters
outline = Outline(Color=ColourSwatch(SwatchColor=RGBA(0, 0, 0, 127)), Width=slider)
outline_2 = Outline(Color=ColourSwatch(SwatchColor=RGB(0, 0, 0)), Width=slider)
move = Move(Geometry=offset, Motion=pt_2)  # -> Geometry, Transform
rec = Rectangle({Plane=PlaneXY(0, 0, 0), Size=Domain2(u=0..240, v=0..240)})
draw = Draw(Curve=move.Geometry, Accuracy=-1, Outline=outline)  # -> SquidInstr, Curve
draw_2 = Draw(Curve=simplify.Curve, Accuracy=-1, Outline=outline_2)  # -> SquidInstr, Curve
merge = Merge(Data1=flatten(draw.SquidInstr), Data2=flatten(draw_2.SquidInstr))
outline_3 = Outline(Color=ColourSwatch(SwatchColor=RGB(0, 0, 0)), Width=Slider(1, range=0..100))
circle = CircleCNR(Center=disc.Points, Normal=Vector(0, 0, 1), Radius=Slider(10, range=0..100))
slider_2 = Slider(3, range=0..10)
squid = Squid(BitmapR=rec, SquidInstr=merge, PPU=1, AA=True, autohide=False)
scale = Scale(Geometry=circle, Center=Point(0, 0, 0), Factor=Slider(0.1, range=0..1))  # -> Geometry, Transform
rec_2 = Rectangle({Plane=PlaneXY(0, 0, 0), Size=Domain2(u=0..24, v=0..24)})
draw_3 = Draw(Curve=scale.Geometry, Accuracy=-1, Outline=outline_3, Fill=ColourSwatch(SwatchColor=RGB(255, 255, 255)))  # -> flatten(SquidInstr), Curve
image = Image(Bitmap=squid, Bounds=rec_2, Interpolate=slider_2)
squid_2 = Squid(BitmapR=rec_2, SquidInstr=[image, draw_3.SquidInstr], PPU=1, AA=True, autohide=False)
image_2 = Image(Bitmap=squid_2, Bounds=rec_2, Interpolate=slider_2)  # -> reverse(SquidInstr)
squid_3 = Squid(BitmapR=rec_2, SquidInstr=[image_2, draw_3.SquidInstr], PPU=1, AA=False, autohide=False)
